# Grasshopper definition a2-gh-model-wip.gh (Grasshopper 1.0.7)

pt = Point(<point referenced from the Rhino model>)
polygon = Polygon(Plane=pt, Radius=Slider(3, range=0..10), Segments=Slider(8, range=0..10), FilletRadius=0)  # -> Polygon, Length
brep = Brep(polygon.Polygon)
crv = Curve(brep)
